# Grasshopper definition kmeans.ghx (Grasshopper 0.9.76)
# plug-ins: Python Interpreter

path = FilePath("C:\4.projects\ML\gh_data\main\iris_data_set.csv")
panel = Panel("""1
5
9""")
panel_2 = Panel("""0
2
4""")
file = ReadFile(File=path, PerLineParse=True)
pt = Point(graft([<point referenced from the Rhino model> x3]))
graft = GraftTree(Tree=panel_2, IncludeEmptyLists=True, IncludeNullItems=True)
graft_2 = GraftTree(Tree=panel, IncludeEmptyLists=True, IncludeNullItems=True)
split = TextSplit(Text=file, Separators=";")
panel_3 = Panel("""1
5
9""")
panel_4 = Panel("""0
2
4""")
lng = ListLength(List=split)
item = ListItem(List=split, Index=0, Wrap=True)  # -> Item, Item1, Item2
random = Random(Range=Domain(0, 1), Number=25, Seed=8)
random_2 = Random(Range=Domain(0, 1), Number=25, Seed=6)
flatten = FlattenTree(Tree=pt, Path="{0}")
graft_3 = GraftTree(Tree=panel_4, IncludeEmptyLists=True, IncludeNullItems=True)
graft_4 = GraftTree(Tree=panel_3, IncludeEmptyLists=True, IncludeNullItems=True)
split_2 = SplitList(List=split, Index=expr("x-1", lng))  # -> ListA, ListB
lng_2 = ListLength(List=flatten)
X = UnitX(Factor=pt)
Z = UnitZ(Factor=pt)
panel_5 = Panel(lng_2)
random_3 = Random(Range=Domain(0.1, 0.25), Number=25, Seed=graft_3)
random_4 = Random(Range=Domain(0, 360), Number=25, Seed=graft_4)
amp = Amplitude(Vector=X, Amplitude=1)
sph = Sphere(Base=PlaneXY(0, 0, 0), Radius=0.5)
pt_2 = ConstructPoint(XCoordinate=random_2, YCoordinate=random, ZCoordinate=0)
rad = Radians(Degrees=random_4)
join = TextJoin(Text=split_2.ListA, Join=",")
panel_6 = Panel(join)
series = Series(Start=0, Step=1, Count=10)
vrot = Rotate(Vector=amp, Axis=Z, Angle=rad)
jitter = Jitter(List=vrot, Jitter=1, Seed=4)  # -> Values, Indices
evalsrf = EvaluateSurface(Surface=reparameterize(sph), Point=pt_2)  # -> Point, Normal, Frame
amp_2 = Amplitude(Vector=jitter.Values, Amplitude=random_3)
flatten_2 = FlattenTree(Tree=join, Path="{0}")
move = Move(Geometry=simplify(pt), Motion=simplify(amp_2))  # -> Geometry, Transform
pt_3 = Point(evalsrf.Point)
number_slider = Slider(0.25, range=0..1)
pt_4 = Point(graft([<point referenced from the Rhino model> x3]))
path_2 = FilePath("C:\4.projects\ML\gh_data\main\kmeans.py")
file_2 = ReadFile(File=path_2, PerLineParse=False)
box = DomainBox(Base=pt_4, X=" 0 To .25", Y=" 0 To .25", Z=" 0 To .25")
sph_2 = Sphere(Base=pt_4, Radius=number_slider)
msphere = MeshSphere(Base=pt_4, Radius=number_slider, UCount=10, VCount=20)
kmeans = PythonScript(Code=file_2, C_num=Slider(3, range=0..10), Data_set=flatten_2)  # -> Out, A, C_points, Labels, Centroids, Centr_labels, Centr
item_2 = ListItem(List=kmeans.Out, Index=0, Wrap=True)  # -> Item, Item1, Item2, Item3, Item4, Item5
panel_7 = Panel(item_2.Item3)
popgeo = PopulateGeometry(Geometry=msphere, Count=Slider(25, range=0..100), Seed=1)
pop3d = Populate3D(Region=box, Count=100, Seed=Slider(6, range=0..10))
pt_5 = Point(flatten(pop3d))
pdecon = Deconstruct(Point=graft(pt_5))  # -> XComponent, YComponent, ZComponent
panel_8 = Panel(pt_5)
merge = Merge(Data1=pdecon.XComponent, Data2=pdecon.YComponent, Data3=pdecon.ZComponent)
join_2 = TextJoin(Text=merge, Join=",")
flatten_3 = FlattenTree(Tree=join_2, Path="{0}")
panel_9 = Panel(kmeans.Out)
chars = Characters(Text=panel_7)  # -> Result, Unicode
pt_6 = ConstructPoint(XCoordinate=item.Item, YCoordinate=item.Item1, ZCoordinate=item.Item2)
col = Colour([ColourSwatch(SwatchColor=RGB(94, 191, 255)), ColourSwatch(SwatchColor=RGB(255, 56, 202)), ColourSwatch(SwatchColor=RGB(56, 255, 96)), ColourSwatch(SwatchColor=RGB(255, 228, 56))])
flatten_4 = FlattenTree(Tree=pt_6, Path="{0}")
item_3 = ListItem(List=col, Index=chars.Result, Wrap=True)
dots = DotDisplay(Point=flatten_4, Colour=item_3, Size=0.03)
